# Grasshopper definition WindPACT.gh (Grasshopper 1.0.7)
# plug-ins: Kangaroo2 Components

# ----
# 4
# 0
# 3
# 1
# 2
# User data
# 1,5 MW
# 750 kW
# 3 MW
# 5 MW
type_of_hawt = Slider(3, range=0..4)
control_volume = BooleanToggle(True)

altura_do_cubo = Panel("60")
altura_do_cubo_2 = Panel("84")
raio_do_cubo = Panel("1.25")
raio_do_cubo_2 = Panel("1.75")
raio_do_cubo_3 = Panel("3.2")
altura_do_cubo_3 = Panel("119")
raio_do_cubo_4 = Panel("2.475")
altura_do_cubo_4 = Panel("154")
stream_filter = StreamFilter(Gate=type_of_hawt, Stream0=raio_do_cubo, Stream1=raio_do_cubo_2, Stream2=raio_do_cubo_4, Stream3=raio_do_cubo_3)
stream_filter_2 = StreamFilter(Gate=type_of_hawt, Stream0=altura_do_cubo, Stream1=altura_do_cubo_2, Stream2=altura_do_cubo_3, Stream3=altura_do_cubo_4)
shaft_connection_diam = Panel("1.2")
shaft_connection_diam_2 = Panel("1.6587")
shaft_connection_diam_3 = Panel("2.354")
shaft_connection_diam_4 = Panel("3.09")
diâmetro_da_pá = Panel("2.673")
diâmetro_da_pá_2 = Panel("1.35")
diâmetro_da_pá_3 = Panel("1.889")
diâmetro_da_pá_4 = Panel("3.456")
coord_em_x_do_cubo = Panel("4.65")
coord_em_x_do_cubo_2 = Panel("2.33")
coord_em_x_do_cubo_3 = Panel("3.3")
coord_em_x_do_cubo_4 = Panel("6")
stream_filter_3 = StreamFilter(
    Gate=type_of_hawt,
    Stream0=shaft_connection_diam,
    Stream1=shaft_connection_diam_2,
    Stream2=shaft_connection_diam_3,
    Stream3=shaft_connection_diam_4)
coord_x = StreamFilter(
    Gate=type_of_hawt,
    Stream0=coord_em_x_do_cubo_2,
    Stream1=coord_em_x_do_cubo_3,
    Stream2=coord_em_x_do_cubo,
    Stream3=coord_em_x_do_cubo_4)
stream_filter_4 = StreamFilter(Gate=type_of_hawt, Stream0=diâmetro_da_pá_2, Stream1=diâmetro_da_pá_3, Stream2=diâmetro_da_pá, Stream3=diâmetro_da_pá_4)

profundidade_nacele = Panel("3.1392")
profundidade_nacele_2 = Panel("2.665")
raio_fillet = Panel("0.105")
raio_fillet_2 = Panel("0.1333")
raio_fillet_3 = Panel("0.157")
profundidade_nacele_3 = Panel("2.1")
profundidade_nacele_4 = Panel("4.5")
profundidade_nacele_5 = Panel("6")
raio_fillet_4 = Panel("0.225")
raio_fillet_5 = Panel(".4")
stream_filter_5 = StreamFilter(
    Gate=type_of_hawt,
    Stream0=raio_fillet,
    Stream1=raio_fillet_2,
    Stream2=raio_fillet_3,
    Stream3=raio_fillet_4,
    Stream4=raio_fillet_5)
stream_filter_6 = StreamFilter(
    Gate=type_of_hawt,
    Stream0=profundidade_nacele_3,
    Stream1=profundidade_nacele_2,
    Stream2=profundidade_nacele,
    Stream3=profundidade_nacele_4,
    Stream4=profundidade_nacele_5)
comprimento_nacele = Panel("4.62")
comprimento_nacele_2 = Panel("3.262")
comprimento_nacele_3 = Panel("6.51")
comprimento_nacele_4 = Panel("8.4")
comprimento_nacele_5 = Panel("10")
altura_nacele = Panel("2.66")
altura_nacele_2 = Panel("3.22")
altura_nacele_3 = Panel("4.538")
altura_nacele_4 = Panel("5.856")
altura_nacele_5 = Panel("7")
stream_filter_7 = StreamFilter(
    Gate=type_of_hawt,
    Stream0=altura_nacele,
    Stream1=altura_nacele_2,
    Stream2=altura_nacele_3,
    Stream3=altura_nacele_4,
    Stream4=altura_nacele_5)
stream_filter_8 = StreamFilter(
    Gate=type_of_hawt,
    Stream0=comprimento_nacele_2,
    Stream1=comprimento_nacele,
    Stream2=comprimento_nacele_3,
    Stream3=comprimento_nacele_4,
    Stream4=comprimento_nacele_5)

file_path = FilePath("C:\Users\thbiz\Documentos\USP\Geometrias de Turbinas\Rhino\Arquivos de coordenadas\Pa_750kW_outra.txt")
file_path_2 = FilePath("C:\Users\thbiz\Documentos\USP\Geometrias de Turbinas\Rhino\Arquivos de coordenadas\Pa_1_5MW_teste2.txt")
file_path_3 = FilePath("C:\Users\thbiz\Documentos\USP\Geometrias de Turbinas\Rhino\Arquivos de coordenadas\Pa_3MW_outra.txt")
# Inputs
file_path_4 = FilePath("C:\Users\thbiz\Documentos\USP\Geometrias de Turbinas\Rhino\Arquivos de coordenadas\Pa_5MW_outra.txt")
file_path_5 = FilePath("C:\Users\thbiz\Documentos\USP\Geometrias de Turbinas\Rhino\Arquivos de coordenadas\Pa_1_5MW.txt")
file_path_6 = FilePath("C:\Users\thbiz\Documentos\USP\Geometrias de Turbinas\Rhino\Arquivos de coordenadas\Pa_750kW.txt")
file_path_7 = FilePath("C:\Users\thbiz\Documentos\USP\Geometrias de Turbinas\Rhino\Arquivos de coordenadas\Pa_750kW.txt")
file_path_8 = FilePath("C:\Users\thbiz\Documentos\USP\Geometrias de Turbinas\Rhino\Arquivos de coordenadas\Pa_5MW.txt")
stream_filter_9 = StreamFilter(Gate=type_of_hawt, Stream0=file_path, Stream1=file_path_2, Stream2=file_path_3, Stream3=file_path_4)
stream_filter_10 = StreamFilter(Gate=type_of_hawt, Stream0=file_path_7, Stream1=file_path_5, Stream2=file_path_6, Stream3=file_path_8)
diâmetro_do_rotor = Panel("99")
diâmetro_do_rotor_2 = Panel("50")
diâmetro_do_rotor_3 = Panel("70")
diâmetro_do_rotor_4 = Panel("128")
ângulo_de_rotação_da_pá = Panel("-pi/2")
ângulo_tilt = Panel("pi/36")
stream_filter_11 = StreamFilter(
    Gate=type_of_hawt,
    Stream0=diâmetro_do_rotor_2,
    Stream1=diâmetro_do_rotor_3,
    Stream2=diâmetro_do_rotor,
    Stream3=diâmetro_do_rotor_4)

file_path_9 = FilePath("C:\Users\thbiz\Documentos\USP\Geometrias de Turbinas\Rhino\Arquivos de coordenadas\Torre_1_5MW.txt")
file_path_10 = FilePath("C:\Users\thbiz\Documentos\USP\Geometrias de Turbinas\Rhino\Arquivos de coordenadas\Torre_750kW.txt")
file_path_11 = FilePath("C:\Users\thbiz\Documentos\USP\Geometrias de Turbinas\Rhino\Arquivos de coordenadas\Torre_3MW.txt")
file_path_12 = FilePath("C:\Users\thbiz\Documentos\USP\Geometrias de Turbinas\Rhino\Arquivos de coordenadas\Torre_5MW.txt")
file_path_13 = FilePath("C:\Users\thbiz\Documentos\USP\Geometrias de Turbinas\Rhino\Arquivos de coordenadas\Torre_5MW.txt")
stream_filter_12 = StreamFilter(
    Gate=type_of_hawt,
    Stream0=file_path_10,
    Stream1=file_path_9,
    Stream2=file_path_11,
    Stream3=file_path_12,
    Stream4=file_path_13)

# ----
# Tower
dados_torre = Data(stream_filter_12)

# ----
# Hub
raio = Number(stream_filter)
coord_x_2 = Number(coord_x)
shaft_connection_diam_5 = Number(stream_filter_3)
altura = Number(stream_filter_2)
number = Number(stream_filter_4)

# ----
# Nacelle
comprimento = Number(stream_filter_8)
profundidade = Number(stream_filter_6)
altura_2 = Number(stream_filter_7)
raio_fillet_6 = Number(stream_filter_5)

# ----
# Blade
diâm_rotor = Number(stream_filter_11)
data = Data(stream_filter_9)
number_2 = Number(ângulo_de_rotação_da_pá)
number_3 = Number(ângulo_tilt)

# ----
# Control Volume Blade
multiplication = Multiplication(A=diâm_rotor, B=0.75)
multiplication_2 = Multiplication(A=multiplication, B=-2)
construct_point = ConstructPoint(XCoordinate=multiplication, YCoordinate=0, ZCoordinate=0)
construct_point_2 = ConstructPoint(XCoordinate=multiplication_2, YCoordinate=0, ZCoordinate=0)
# Development
multiplication_3 = Multiplication(A=diâm_rotor, B=2)
yz_plane = YZPlane(Origin=construct_point)
yz_plane_2 = YZPlane(Origin=construct_point_2)
arc = Arc(Plane=yz_plane, Radius=diâm_rotor, Angle=Domain(2.094396, 4.18879))  # -> Arc, Length
arc_2 = Arc(Plane=yz_plane_2, Radius=multiplication_3, Angle=Domain(2.094396, 4.18879))  # -> Arc, Length
end_points = EndPoints(Curve=arc.Arc)  # -> Start, End
end_points_2 = EndPoints(Curve=arc_2.Arc)  # -> Start, End
line = Line(StartPoint=construct_point, EndPoint=[end_points.Start, end_points.End])
line_2 = Line(StartPoint=construct_point_2, EndPoint=[end_points_2.Start, end_points_2.End])
join_curves = JoinCurves(Curves=[line, arc.Arc], Preserve=False)
join_curves_2 = JoinCurves(Curves=[line_2, arc_2.Arc], Preserve=False)
loft = Loft(
    Curves=[join_curves, join_curves_2],
    Options={Adjust=False, Closed=False, LoftEnds=0, LoftSimp=0, LoftType=0, Rebuild=10, Refit=0.01})
cap_holes = CapHoles(Brep=loft)
# Outputs
stream_filter_13 = StreamFilter(Gate=control_volume, Stream0=Point(0, 0, 0), Stream1=cap_holes)

# ---- group: Torre
# Tower
import_coordinates = ImportCoordinates(File=dados_torre, Separator=",", XIndex=0, YIndex=1, ZIndex=2)
deconstruct = Deconstruct(Point=import_coordinates)  # -> XComponent, YComponent, ZComponent
construct_point_3 = ConstructPoint(XCoordinate=0, YCoordinate=0, ZCoordinate=deconstruct.XComponent)
division = Division(A=deconstruct.YComponent, B="2")
subtraction = Subtraction(A=division, B=deconstruct.ZComponent)
circle = Circle(Plane=construct_point_3, Radius=subtraction)
circle_2 = Circle(Plane=construct_point_3, Radius=division)
torre = Loft(Curves=circle, Options={Adjust=False, Closed=False, LoftEnds=0, LoftSimp=0, LoftType=0, Rebuild=10, Refit=0.01})
torre_2 = Loft(Curves=circle_2, Options={Adjust=False, Closed=False, LoftEnds=0, LoftSimp=0, LoftType=0, Rebuild=10, Refit=0.01})
cap_holes_2 = CapHoles(Brep=torre)
cap_holes_3 = CapHoles(Brep=torre_2)
solid_difference = SolidDifference(BrepsA=cap_holes_3, BrepsB=cap_holes_2)

# ---- group: Nacele
# Nacelle
multiplication_4 = Multiplication(A=raio_fillet_6, B=2)
cluster = Cluster(A_2=shaft_connection_diam_5, A_3=coord_x_2, A=raio)
addition = Addition(A=profundidade, B=multiplication_4)
division_2 = Division(A=addition, B="-2")
division_3 = Division(A=altura_2, B="-2")
subtraction_2 = Subtraction(A=cluster, B=comprimento)
addition_2 = Addition(A=division_3, B=altura)
construct_point_4 = ConstructPoint(XCoordinate=subtraction_2, YCoordinate=division_2, ZCoordinate=addition_2)
rectangle = Rectangle(Plane=construct_point_4, XSize=comprimento, YSize=addition, Radius=0)  # -> Rectangle, Length
box_rectangle = BoxRectangle(Rectangle=rectangle.Rectangle, Height=altura_2)
fillet_edge = FilletEdge(Shape=box_rectangle, Blend=0, Metric=0, Edges=[0, 1, 2, 3, 4, 5, 6, 7, 8, 9, 10, 11], Radii=raio_fillet_6)

# ----
# Control Volume HAWT
addition_3 = Addition(A=altura, B=diâm_rotor)
division_4 = Division(A=addition_3, B=2)
unit_z = UnitZ(Factor=division_4)
center_box = CenterBox(Base=PlaneXY(0, 0, 0), X=altura, Y=diâm_rotor, Z=division_4)
move = Move(Geometry=center_box, Motion=unit_z)  # -> Geometry, Transform
stream_filter_14 = StreamFilter(Gate=control_volume, Stream0=Point(0, 0, 0), Stream1=move.Geometry)

# ---- group: Pá
# Single Blade
import_coordinates_2 = ImportCoordinates(File=data, Separator=",", XIndex=0, YIndex=1, ZIndex=2)
deconstruct_2 = Deconstruct(Point=import_coordinates_2)  # -> XComponent, YComponent, ZComponent
create_set = CreateSet(List=deconstruct_2.ZComponent)  # -> Set, Map
list_length = ListLength(List=create_set.Set)
reverse_list = ReverseList(List=import_coordinates_2)
list_length_2 = ListLength(List=import_coordinates_2)
division_5 = Division(A=list_length_2, B=list_length)
partition_list = PartitionList(List=import_coordinates_2, Size=division_5)
subtraction_3 = Subtraction(A=list_length_2, B=division_5)
removeduplicatepts = RemoveDuplicatePts(Points=partition_list, Tolerance=0.0001)
cluster_2 = Cluster_2(A=number, B=raio)
split_list = SplitList(List=import_coordinates_2, Index=subtraction_3)  # -> ListA, ListB
polyline = PolyLine(Vertices=removeduplicatepts, Closed=True)
split_list_2 = SplitList(List=reverse_list, Index=subtraction_3)  # -> ListA, ListB
unit_z_2 = UnitZ(Factor=cluster_2)
removeduplicatepts_2 = RemoveDuplicatePts(Points=split_list.ListB, Tolerance=1e-05)
polyline_2 = PolyLine(Vertices=split_list_2.ListB, Closed=False)
split_list_3 = SplitList(List=flatten(polyline), Index=1)  # -> ListA, ListB
move_2 = Move(Geometry=split_list_3.ListA, Motion=unit_z_2)  # -> Geometry, Transform
polyline_3 = PolyLine(Vertices=removeduplicatepts_2, Closed=True)
polygon_center = PolygonCenter(Polyline=polyline_2)  # -> CenterV, CenterE, CenterA
merge = Merge(Data1=move_2.Geometry, Data2=split_list_3.ListB)
boundary_surfaces = BoundarySurfaces(Edges=polyline_3)
loft_options = LoftOptions(Closed=False, Adjust=False, Rebuild=0, Refit=0, Type=3)
flatten_tree = FlattenTree(Tree=merge, Path="{0}")
boundary_surfaces_2 = BoundarySurfaces(Edges=move_2.Geometry)
deconstruct_3 = Deconstruct(Point=polygon_center.CenterV)  # -> XComponent, YComponent, ZComponent
cluster_3 = Cluster_6(curve=flatten_tree, size="60")
cluster_4 = Cluster_5(list=cluster_3, options=loft_options)
construct_point_5 = ConstructPoint(XCoordinate=deconstruct_3.XComponent, YCoordinate=0, ZCoordinate=altura)
brep_join = BrepJoin(Breps=cluster_4)  # -> Breps, Closed

# ----
# Spares
spar_1 = BooleanToggle(True)
spar_2 = BooleanToggle(True)
cluster_5 = Cluster_4(
    point=import_coordinates_2,
    count=list_length,
    B="0.16",
    cutter=brep_join.Breps,
    domain_end=list_length_2,
    z_coordinate=create_set.Set)
cluster_6 = Cluster_4(
    point=import_coordinates_2,
    count=list_length,
    B="0.5",
    cutter=brep_join.Breps,
    domain_end=list_length_2,
    z_coordinate=create_set.Set)
stream_filter_15 = StreamFilter(Gate=spar_2, Stream0=Point(0, 0, 0), Stream1=cluster_6)
stream_filter_16 = StreamFilter(Gate=spar_1, Stream0=Point(0, 0, 0), Stream1=cluster_5)

# ---- group: Pá (continued)
merge_2 = Merge(
    Data1=boundary_surfaces,
    Data2=brep_join.Breps,
    Data3=stream_filter_16,
    Data4=stream_filter_15,
    Data5=boundary_surfaces_2)
rotate_3d = Rotate3D(Geometry=merge_2, Angle=number_2, Center=construct_point_5, Axis=Vector(0, 0, 1))  # -> Geometry, Transform
rotate_3d_2 = Rotate3D(Geometry=rotate_3d.Geometry, Angle=1.570796327, Center=Point(0, 0, 0), Axis=Vector(1, 0, 0))  # -> simplify(flatten(Geometry)), Transform
list_item = ListItem(List=rotate_3d_2.Geometry, Index=0, Wrap=True)
cap_holes_4 = CapHoles(Brep=list_item)

# ----
# Breps Blade
brep = Brep(cap_holes_4)
brep_2 = Brep(rotate_3d_2.Geometry)

# ----
# Result Blade
merge_3 = Merge(Data1=brep, Data2=brep_2, Data3=stream_filter_13)

# ----
# 3 Blades
construct_point_6 = ConstructPoint(XCoordinate=0, YCoordinate=0, ZCoordinate=altura)
move_3 = Move(Geometry=merge_2, Motion=construct_point_6)  # -> Geometry, Transform
subtraction_4 = Subtraction(A=coord_x_2, B=deconstruct_3.XComponent)
construct_point_7 = ConstructPoint(XCoordinate=deconstruct_3.XComponent, YCoordinate=0, ZCoordinate=altura)
construct_point_8 = ConstructPoint(XCoordinate=subtraction_4, YCoordinate=0, ZCoordinate=0)
rotate_3d_3 = Rotate3D(Geometry=move_3.Geometry, Angle=number_2, Center=construct_point_5, Axis=Vector(0, 0, 1))  # -> Geometry, Transform
rotação_das_pás = Slider(0, range=0..24, expression="15*x")
list_item_2 = ListItem(List=flatten(rotate_3d_3.Geometry), Index=0, Wrap=True)
yz_plane_3 = YZPlane(Origin=construct_point_7)
cap_holes_5 = CapHoles(Brep=list_item_2)

# ---- group: Cubo
# Hub
construct_point_9 = ConstructPoint(XCoordinate=coord_x_2, YCoordinate=0, ZCoordinate=altura)
yz_plane_4 = YZPlane(Origin=construct_point_9)
sphere = Sphere(Base=yz_plane_4, Radius=raio)
solid_intersection = SolidIntersection(BrepsA=fillet_edge, BrepsB=sphere)
solid_difference_2 = SolidDifference(BrepsA=sphere, BrepsB=solid_intersection)

# ----
cluster_7 = Cluster_3(
    geometry=cap_holes_5,
    motion=construct_point_8,
    plane=yz_plane_3,
    angle_2=rotação_das_pás,
    angle=number_3,
    center=construct_point_9)
cluster_8 = Cluster_3(
    geometry=rotate_3d_3.Geometry,
    motion=construct_point_8,
    plane=yz_plane_3,
    angle_2=rotação_das_pás,
    angle=number_3,
    center=construct_point_9)

# ---- group: Cubo (continued)
solid_difference_3 = SolidDifference(BrepsA=solid_difference_2, BrepsB=cluster_7)

# ----
deconstruct_brep = DeconstructBrep(Brep=solid_difference_3)  # -> Faces, Edges, Vertices
area = Area(Geometry=deconstruct_brep.Faces)  # -> Area, Centroid
deconstruct_brep_2 = DeconstructBrep(Brep=box_rectangle)  # -> Faces, Edges, Vertices
larger_than = LargerThan(FirstNumber=area.Area, SecondNumber=1)  # -> LargerThan, OrEqualTo
cull_pattern = CullPattern(List=deconstruct_brep.Faces, CullPattern=larger_than.LargerThan)

# ----
# Breps HAWT
brep_3 = Brep(solid_difference_3)
brep_4 = Brep(cap_holes_3)
brep_5 = Brep(solid_difference)
brep_6 = Brep(fillet_edge)
brep_7 = Brep(cluster_8)

# ----
# Surfaces
surface = Surface(torre_2)
surface_2 = Surface(deconstruct_brep_2.Faces)
surface_3 = Surface(cull_pattern)

# ----
# Result HAWT
merge_4 = Merge(Data1=stream_filter_14, Data2=brep_4, Data3=brep_5, Data4=brep_6, Data5=brep_3, Data6=brep_7)
merge_5 = Merge(Data1=surface, Data2=surface_2, Data3=surface_3)

merge_6 = Merge(Data1=merge_4, Data2=merge_5)

# ==== cluster Cluster
A = ClusterInput()
A_2 = ClusterInput()
A_3 = ClusterInput()

multiplication = Multiplication(A=A, B=2)
division = Division(A=A_2, B=multiplication)
arcsine = ArcSine(Value=division)
cosine = Cosine(Value=arcsine)
multiplication_2 = Multiplication(A=cosine, B=A)
subtraction = Subtraction(A=A_3, B=multiplication_2)

result = ClusterOutput(subtraction)

# ==== cluster Cluster_2
A = ClusterInput()
B = ClusterInput()
division = Division(A=A, B=2)
division_2 = Division(A=division, B=B)
arcsine = ArcSine(Value=division_2)
cosine = Cosine(Value=arcsine)
subtraction = Subtraction(A=1, B=cosine)
multiplication = Multiplication(A=B, B=subtraction)
multiplication_2 = Multiplication(A=multiplication, B=-1)
result = ClusterOutput(multiplication_2)

# ==== cluster Cluster_3
plane = ClusterInput()
geometry = ClusterInput()
motion = ClusterInput()
center = ClusterInput()
move = Move(Geometry=geometry, Motion=motion)  # -> Geometry, Transform
polar_array = PolarArray(Geometry=move.Geometry, Plane=plane, Count=3, Angle=6.283185307)  # -> Geometry, Transform
angle = ClusterInput()
rotate_3d = Rotate3D(Geometry=polar_array.Geometry, Angle=angle, Center=center, Axis=Vector(0, -1, 0))  # -> Geometry, Transform
angle_2 = ClusterInput()
rotate_3d_2 = Rotate3D(Geometry=rotate_3d.Geometry, Angle=angle_2, Center=center, Axis=Vector(1, 0, 0))  # -> flatten(Geometry), Transform
geometry_2 = ClusterOutput(rotate_3d_2.Geometry)

# ==== cluster Cluster_4
domain_end = ClusterInput()
construct_domain = ConstructDomain(DomainStart=0, DomainEnd=domain_end)
point = ClusterInput()
count = ClusterInput()
deconstruct = Deconstruct(Point=point)  # -> XComponent, YComponent, ZComponent
divide_domain = DivideDomain(Domain=construct_domain, Count=count)
sub_list = SubList(List=deconstruct.XComponent, Domain=divide_domain, Wrap=False)  # -> List, Index
bounds = Bounds(Numbers=sub_list.List)
deconstruct_domain = DeconstructDomain(Domain=bounds)  # -> Start, End
subtraction = Subtraction(A=deconstruct_domain.End, B=deconstruct_domain.Start)
B = ClusterInput()
z_coordinate = ClusterInput()
multiplication = Multiplication(A=subtraction, B=B)
construct_point = ConstructPoint(XCoordinate=flatten(multiplication), YCoordinate=5, ZCoordinate=z_coordinate)
construct_point_2 = ConstructPoint(XCoordinate=flatten(multiplication), YCoordinate=-5, ZCoordinate=z_coordinate)
line = Line(StartPoint=construct_point, EndPoint=construct_point_2)
split_list = SplitList(List=line, Index=1)  # -> ListA, ListB
loft = Loft(
    Curves=split_list.ListB,
    Options={Adjust=False, Closed=False, LoftEnds=0, LoftSimp=0, LoftType=0, Rebuild=10, Refit=0.01})
cutter = ClusterInput()
split_brep = SplitBrep(Brep=loft, Cutter=flatten(cutter))
list_item = ListItem(List=split_brep, Index=0, Wrap=True)
i = ClusterOutput(list_item)

# ==== cluster Cluster_5
options = ClusterInput()
list = ClusterInput()
loft = Loft(Curves=list, Options=options)
split_list = SplitList(List=list, Index=1)  # -> ListA, ListB
list_length = ListLength(List=list)
reverse_list = ReverseList(List=split_list.ListB)
subtraction = Subtraction(A=list_length, B=1)
split_list_2 = SplitList(List=reverse_list, Index=1)  # -> ListA, ListB
subtraction_2 = Subtraction(A=list_length, B=2)
split_list_3 = SplitList(List=list, Index=subtraction)  # -> ListA, ListB
reverse_list_2 = ReverseList(List=split_list_2.ListB)
list_length_2 = ListLength(List=reverse_list_2)
loft_options = LoftOptions(Closed=False, Adjust=False, Rebuild=0, Refit=0, Type=0)
subtraction_3 = Subtraction(A=list_length_2, B=1)
partition_list = PartitionList(List=split_list_3.ListA, Size=2)
split_list_4 = SplitList(List=list, Index=subtraction_2)  # -> ListA, ListB
split_list_5 = SplitList(List=reverse_list_2, Index=subtraction_3)  # -> ListA, ListB
loft_2 = Loft(Curves=partition_list, Options=loft_options)
partition_list_2 = PartitionList(List=split_list_5.ListA, Size=2)
cap_holes = CapHoles(Brep=flatten(loft_2))
loft_3 = Loft(Curves=partition_list_2, Options=loft_options)
loft_4 = Loft(Curves=split_list_4.ListB, Options=loft_options)
brep_join = BrepJoin(Breps=flatten(loft_3))  # -> Breps, Closed
merge = Merge(Data1=loft_2, Data2=loft_4, Data3=loft_3)  # -> flatten(Result)
panel = Panel(merge)
result = ClusterOutput(merge)

# ==== cluster Cluster_6
size = ClusterInput()
curve = ClusterInput()
divide_curve = DivideCurve(Curve=curve, Count=size, Kinks=False)  # -> Points, Tangents, Parameters
partition_list = PartitionList(List=divide_curve.Points, Size=size)
polyline = PolyLine(Vertices=partition_list, Closed=True)  # -> flatten(Polyline)
polyline_2 = ClusterOutput(polyline)
